# Grasshopper definition 240108-number-relation.gh (Grasshopper 1.0.7)

panel = Panel("""String 1
String 2
String 3""")
list = ValueList({"标准层", "首层", "其他变异层"}, selected="标准层")
list_2 = ValueList({"标准层", "首层", "其他变异层"}, selected="标准层")
crv = Curve(<curve referenced from the Rhino model>)
list_3 = ValueList({"洋房", "小高", "大高"}, selected="小高")
list_4 = ValueList({"洋房", "小高", "大高"}, selected="大高")
crv_2 = Curve(<curve referenced from the Rhino model>)
index = ItemIndex(List=panel, Item=Slider(1, range=0..10))
户型1 = 户型1(
    高度类别=list_4,
    变异类别=list_2,
    户型套内面积=Slider(90, range=20..200),
    户型非核心筒公摊面积=Slider(20, range=20..200),
    套内精装单方成本=Slider(850, range=0..10000),
    面宽=Slider(12, range=0..12),
    进深=Slider(12, range=0..12),
    户型轮廓线=crv,
    得房率=Slider(0.75, range=0..1))  # -> 户型名_2, 高度类别_3, 变异类别_3, 户型套内面积_3, 户型非核心筒公摊面积_3, 套内精装单方成本_3, 户型轮廓线_3, 得房率_3
户型2 = 户型1(
    高度类别=list_3,
    变异类别=list,
    户型套内面积=Slider(96.12, range=20..200),
    户型非核心筒公摊面积=Slider(20, range=20..200),
    套内精装单方成本=Slider(1000, range=0..10000),
    面宽=Slider(12, range=0..12),
    进深=Slider(12, range=0..12),
    户型轮廓线=crv_2,
    得房率=Slider(0.78, range=0..1))  # -> 户型名_2, 高度类别_3, 变异类别_3, 户型套内面积_3, 户型非核心筒公摊面积_3, 套内精装单方成本_3, 户型轮廓线_3, 得房率_3
crv_3 = Curve(<curve referenced from the Rhino model>)
panel_2 = Panel(index)
list_5 = ValueList({"户型1", "户型2", "户型3"}, selected="户型3")
area = Area(Geometry=crv_3)  # -> Area, Centroid
customer_object = GhPythonScript()  # -> out, a
# ---------- customer_object: Python ----------
__author__ = "liq32"
__version__ = "2024.01.09"

import rhinoscriptsyntax as rs

class CustomObject:
    def __init__(self, name, attribute1, attribute2):
        self.name = name
        self.attribute1 = attribute1
        self.attribute2 = attribute2

    def describe(self):
        return "{} has attributes {} and {}".format(self.name, self.attribute1, self.attribute2)
# ---------- end customer_object ----------
trigger = Trigger(Interval=-1000, TimerInterval=1000)
用地面积 = Number(area.Area)
其他地上计容建筑面积 = Number()
住宅地上建筑面积 = Number()
规划地上容积率 = Number(Slider(2, range=0..10))
python = GhPythonScript(selected_type=list_5)  # -> attributes, a
# ---------- python: Python ----------
__author__ = "liq32"
__version__ = "2024.01.09"

import rhinoscriptsyntax as rs

# Define apartment types and their attributes
# Define apartment types and their attributes
apartments = {
    "户型1": {"size": "1000 sqft", "bedrooms": 2, "bathrooms": 1, "balcony": True},
    "户型2": {"size": "1200 sqft", "bedrooms": 3, "bathrooms": 2, "balcony": False},
    "户型3": {"size": "800 sqft", "bedrooms": 1, "bathrooms": 1, "balcony": True}
}

# selected_type is the input from the Value List component
attributes = apartments.get(selected_type, "Apartment type not found")

# Output the attributes
a = attributes

print(selected_type,attributes)
# ---------- end python ----------
panel_3 = Panel(customer_object.out)
panel_4 = Panel(customer_object.a)
gate = StreamGate(Stream=户型2.户型名_2, Gate=0)  # -> Target0, Target1
list_6 = ValueList({"One": 1}, selected="One")
item = ListItem(List=list_6, Index=0, Wrap=True)
multiplication = Multiplication(A=用地面积, B=规划地上容积率)
addition = Addition(A=住宅地上建筑面积, B=其他地上计容建筑面积)
户型 = GhPythonScript(
    height_catagory=户型2.高度类别_3,
    level_type=户型2.变异类别_3,
    interior_area=户型1.户型套内面积_3,
    interior_deco_cost_per_interior_area=户型1.套内精装单方成本_3,
    contour=户型1.户型轮廓线_3)  # -> out, construction_area, a
# ---------- 户型: Python ----------
__author__ = "liq32"
__version__ = "2024.01.09"

import rhinoscriptsyntax as rs

# Example structure for inputs
# Apartment Type A attributes
a_size = "1000 sqft" # Input from a panel or slider
a_bedrooms = 2       # Input from a slider
a_bathrooms = 1      # Input from a slider

# Similar inputs for Apartment Types B and C...

# Organize inputs into a dictionary
apartments = {
    "Apartment Type A": {"size": a_size, "bedrooms": a_bedrooms, "bathrooms": a_bathrooms},
    # Similar structure for Apartment Types B and C...
}

# selected_type is the input from the Value List component
selected_type = "Apartment Type A" # Example, connect this to a Value List component

# Output the attributes of the selected apartment type
attributes = apartments.get(selected_type, "Apartment type not found")

# Define outputs
a = attributes
# ---------- end 户型 ----------
户型_2 = GhPythonScript(
    height_catagory=户型1.高度类别_3,
    level_type=户型1.变异类别_3,
    interior_area=户型1.户型套内面积_3,
    interior_deco_cost_per_interior_area=户型1.套内精装单方成本_3,
    contour=户型1.户型轮廓线_3)  # -> out, construction_area, a; same code as 户型
规划地上建筑面积 = Number(multiplication)
方案地上建筑面积 = Number(addition)
楼型1 = 楼型1()
subtraction = Subtraction(A=规划地上建筑面积, B=方案地上建筑面积)
层户数 = Integer(Slider(2, range=0..10))
integer = Integer(Slider(2, range=0..10))
方案地上建筑面积不足值 = Number(subtraction)
multiplication_2 = Multiplication(A=户型_2.construction_area, B=层户数)
户型1_2 = Apt_type()  # -> out, a; same code as 户型
楼层数 = Integer(Slider(18, range=0..100))
multiplication_3 = Multiplication(A=multiplication_2, B=楼层数)
该户形户数 = Integer(multiplication_3)

# ==== cluster 户型1
户型非核心筒公摊面积 = ClusterInput()
户型套内面积 = ClusterInput()
面宽 = ClusterInput()
高度类别 = ClusterInput()
套内精装单方成本 = ClusterInput()
变异类别 = ClusterInput()
得房率 = ClusterInput()
户型轮廓线 = ClusterInput()
进深 = ClusterInput()
得房率_2 = Number(得房率)
户型轮廓线_2 = Curve(户型轮廓线)
面宽_2 = Number(面宽)
进深_2 = Number(进深)
高度类别_2 = Text(高度类别)
户型名 = Text("120小高标准层")
变异类别_2 = Text(变异类别)
套内精装单方成本_2 = Integer(套内精装单方成本)
户型非核心筒公摊面积_2 = Number(户型非核心筒公摊面积)
户型套内面积_2 = Number(户型套内面积)
户型轮廓线_3 = ClusterOutput(户型轮廓线_2)
得房率_3 = ClusterOutput(得房率_2)
套内精装单方成本_3 = ClusterOutput(套内精装单方成本_2)
户型套内面积_3 = ClusterOutput(户型套内面积_2)
户型名_2 = ClusterOutput(户型名)
户型非核心筒公摊面积_3 = ClusterOutput(户型非核心筒公摊面积_2)
变异类别_3 = ClusterOutput(变异类别_2)
高度类别_3 = ClusterOutput(高度类别_2)

# ==== cluster 楼型1
标准层个数 = ClusterInput()
变异层1个数 = ClusterInput()
变异层2个数 = ClusterInput()
变异层3个数 = ClusterInput()
标准层个数_2 = Integer(标准层个数)
变异层1个数_2 = Integer(变异层1个数)
变异层2个数_2 = Integer(变异层2个数)
首层 = Integer()
变异层3个数_2 = Integer(变异层3个数)
层数 = Integer()
